# Grasshopper definition rhino_brep.gh (Grasshopper 1.0.8)

toggle = BooleanToggle(False)  # disabled
lamcp = LAMCPBridge(enable=toggle)  # -> status; inputs enable: Boolean, port: Int32; disabled
#   port enable: Toggle to start (True) or stop (False) the local HTTP server.
#   port port: Port to listen on (loopback only). Defaults to 8765.
#   port status: Current server status string.
# ---------- lamcp: Python ----------
"""
LAMCP Bridge: local HTTP server inside Rhino 8 / Grasshopper CPython.

Exposes `POST /exec` (JSON: `{"code": "...", "timeout": 30}`) which
exec()s `code` and returns
`{"stdout": "...", "stderr": "...", "result": "...", "error": null|str}`.

Pair with the `lamcp` FastMCP server, which translates Claude's
`run_python_script` MCP tool calls into POSTs to this endpoint.

Binds to 127.0.0.1 only. NEVER expose beyond localhost â€” it exec()s
arbitrary Python with full Rhino API access.

LAMCP v0.1.0
"""

import contextlib
import io
import json
import threading
import traceback
from http.server import BaseHTTPRequestHandler
from http.server import HTTPServer

import Grasshopper
import scriptcontext as sc


SHARED_GLOBALS_KEY = "_lamcp_bridge_globals"
SERVER_KEY = "_lamcp_bridge_server"


def _exec_code(code, timeout):
    """Run `code` on the HTTP-server thread and capture stdout/stderr/result.

    NOTE: this is intentionally NOT marshalled to Rhino's UI thread for the
    spike â€” `Rhino.RhinoApp.InvokeOnUiThread` was queueing actions that
    never fired in Rhino 8 CPython. Most read-only RhinoCommon access is
    safe cross-thread; mutations may crash. Add Eto-based marshalling
    back here when we need it.
    """
    out = io.StringIO()
    err = io.StringIO()
    g = sc.sticky.setdefault(SHARED_GLOBALS_KEY, {"__name__": "__lamcp_bridge__"})
    error_text = None
    result_repr = None
    try:
        with contextlib.redirect_stdout(out), contextlib.redirect_stderr(err):
            exec(code, g, g)
            result_repr = repr(g.get("_"))
    except BaseException:
        error_text = traceback.format_exc()

    return {
        "stdout": out.getvalue(),
        "stderr": err.getvalue(),
        "result": result_repr,
        "error": error_text,
    }


class _ExecHandler(BaseHTTPRequestHandler):
    # Silence default request logging so it doesn't clog the Rhino command line.
    def log_message(self, fmt, *args):
        pass

    def _send(self, code, payload):
        body = json.dumps(payload).encode("utf-8")
        self.send_response(code)
        self.send_header("Content-Type", "application/json")
        self.send_header("Content-Length", str(len(body)))
        self.end_headers()
        self.wfile.write(body)

    def do_GET(self):
        if self.path == "/health":
            self._send(200, {"status": "ok"})
        else:
            self._send(404, {"error": "not found"})

    def do_POST(self):
        if self.path != "/exec":
            self._send(404, {"error": "not found"})
            return
        length = int(self.headers.get("Content-Length", "0"))
        try:
            raw = self.rfile.read(length).decode("utf-8")
            body = json.loads(raw)
            code = body.get("code", "")
            timeout = float(body.get("timeout", 30.0))
        except Exception as exc:
            self._send(400, {"error": "bad request: " + repr(exc)})
            return
        result = _exec_code(code, timeout)
        self._send(200, result)


def _start_server(port):
    server = HTTPServer(("127.0.0.1", port), _ExecHandler)
    thread = threading.Thread(
        target=server.serve_forever, daemon=True, name="lamcp-bridge"
    )
    thread.start()
    return {"server": server, "thread": thread, "port": port}


def _stop_server(state):
    try:
        state["server"].shutdown()
        state["server"].server_close()
    except Exception:
        pass


class LamcpBridgeComponent(Grasshopper.Kernel.GH_ScriptInstance):
    def RunScript(self, enable: bool, port: int):
        port = int(port) if port else 8765

        state = sc.sticky.get(SERVER_KEY)

        if not enable:
            if state is not None:
                _stop_server(state)
                del sc.sticky[SERVER_KEY]
            return "stopped"

        # Already running on the requested port: no-op.
        if (
            state is not None
            and state.get("port") == port
            and state["thread"].is_alive()
        ):
            return "listening on http://127.0.0.1:{}".format(port)

        # Port changed or server died: tear down and restart.
        if state is not None:
            _stop_server(state)
            del sc.sticky[SERVER_KEY]

        try:
            sc.sticky[SERVER_KEY] = _start_server(port)
        except OSError as exc:
            ghenv.Component.AddRuntimeMessage(  # noqa: F821
                Grasshopper.Kernel.GH_RuntimeMessageLevel.Error,
                "Failed to bind 127.0.0.1:{}: {}".format(port, exc),
            )
            return "error: {}".format(exc)

        return "listening on http://127.0.0.1:{}".format(port)
# ---------- end lamcp ----------
brep_from_shape = Brep_from_shape()  # -> geometry, a
# ---------- brep_from_shape: Python ----------
# venv: compas_brep_occ
from compas.geometry import Cylinder, Torus
from compas.scene import Scene
from compas_brep import Brep
import Grasshopper

class Script_Instance(Grasshopper.Kernel.GH_ScriptInstance):
    def RunScript(self):

        cylinder = Brep.from_cylinder(Cylinder(radius=1.0, height=2.0))
        torus = Brep.from_torus(Torus(radius_axis=1.5, radius_pipe=0.3))

        return [cylinder.native_brep, torus.native_brep]
# ---------- end brep_from_shape ----------
brep_from_extrusion = Brep_from_extrusion()  # -> geometry
# ---------- brep_from_extrusion: Python ----------
# venv: compas_brep_occ
import Grasshopper

class Script_Instance(Grasshopper.Kernel.GH_ScriptInstance):
    def RunScript(self):
        from compas.geometry import Circle, Polygon, Vector
        from compas.scene import Scene
        from compas_brep import Brep

        circle = Circle(radius=0.3)
        n = 32
        points = [circle.point_at(i / n) for i in range(n)]
        profile = Polygon(points)

        brep = Brep.from_extrusion(profile, Vector(0, 0, 10))

        return brep.native_brep
# ---------- end brep_from_extrusion ----------
brep_from_loft = Brep_from_loft()  # -> geometry
# ---------- brep_from_loft: Python ----------
# venv: compas_brep_occ
from compas.geometry import Circle, Frame, NurbsCurve
from compas.scene import Scene
from compas_brep import Brep
from compas_brep import NurbsCurve as BrepNC
import Grasshopper

class Script_Instance(Grasshopper.Kernel.GH_ScriptInstance):
    def RunScript(self):

        frame = Frame.worldYZ()
        c1 = Circle(1.0, frame=frame)

        frame = Frame.worldYZ()
        frame.point = [3, 0, 0]
        c2 = Circle(3.0, frame=frame)

        frame = Frame.worldYZ()
        frame.point = [6, 0, 0]
        c3 = Circle(0.5, frame=frame)

        frame = Frame.worldYZ()
        frame.point = [9, 0, 0]
        c4 = Circle(3.0, frame=frame)

        curves = [
            BrepNC.from_circle(c1),
            BrepNC.from_circle(c2),
            BrepNC.from_circle(c3),
            BrepNC.from_circle(c4),
        ]

        brep = Brep.from_loft(curves)

        return brep.native_brep
# ---------- end brep_from_loft ----------
brep_from_mesh = Brep_from_mesh()  # -> geometry
# ---------- brep_from_mesh: Python ----------
# venv: compas_brep_occ
import Grasshopper

class Script_Instance(Grasshopper.Kernel.GH_ScriptInstance):
    def RunScript(self):
        import compas
        from compas.datastructures import Mesh
        from compas.scene import Scene
        from compas_brep import Brep

        mesh = Mesh.from_obj(compas.get("tubemesh.obj"))
        brep = Brep.from_mesh(mesh)

        return brep.native_brep
# ---------- end brep_from_mesh ----------
brep_from_extrusion2 = Brep_from_extrusion2()  # -> r_extrusion, r_polygon
# ---------- brep_from_extrusion2: Python ----------
# venv: compas_brep_occ
import Grasshopper
import Rhino
from compas.geometry import Box, Plane, Polygon, Polyline, Vector, offset_polyline
from compas.scene import Scene
from compas_brep import Brep
from compas_rhino.conversions import polygon_to_rhino, mesh_to_rhino, point_to_rhino, polyline_to_rhino, vector_to_rhino, polyline_to_rhino_curve

# def polyline_to_rhino(polyline):
#     return Rhino.Geometry.Polyline([point_to_rhino(point) for point in polyline] + [point_to_rhino(polyline[0])])

def polygon_to_rhino(polygon):
    # this should return a closed rhino polyline curve
    # Rhino has no polygon, a PolylineCuve will do. however 
    points = polygon.points
    return Rhino.Geometry.PolylineCurve([point_to_rhino(p) for p in points] + [point_to_rhino(points[0])])

class Script_Instance(Grasshopper.Kernel.GH_ScriptInstance):
    def RunScript(self):
        
        # "inflate" polyline on either side
        polyline = Polyline([[0, 0, 0], [10, 0, 0], [10, 10, 0], [0, 10, 0], [0, 5, 0]])
        inside = Polyline(offset_polyline(polyline, 0.05))
        outside = Polyline(offset_polyline(polyline, -0.05))
        polygon = Polygon(outside.points + inside.points[::-1])
        print(polygon)
        r_polygon = polygon_to_rhino(polygon)

        r_extrusion = Rhino.Geometry.Surface.CreateExtrusion(r_polygon, vector_to_rhino(Vector(0, 0, 5)))
        r_extrusion = r_extrusion.ToBrep()
        r_extrusion = r_extrusion.CapPlanarHoles(1e-6)  # this messes up the grasshopper preview, but baked geometry seems alright
        # box = Brep.from_box(Box(10, 1, 3))
        # extrusion = Brep.from_boolean_difference(extrusion, box)

        # plane_brep = Brep.from_plane(Plane([3, 5, 7.5], [1, 0, 0]), domain_u=(-10, 10), domain_v=(-10, 10))
        # extrusion = extrusion.split(plane_brep)[1]

        return r_extrusion, r_polygon
# ---------- end brep_from_extrusion2 ----------
brep_from_booleans = Brep_from_booleans()  # -> geometry
# ---------- brep_from_booleans: Python ----------
# venv: compas_brep_occ
import Grasshopper
from compas.geometry import Box, Cylinder, Frame
from compas.scene import Scene
from compas_brep import Brep

class Script_Instance(Grasshopper.Kernel.GH_ScriptInstance):
    def RunScript(self):

        R = 1.4
        box = Brep.from_box(Box(2 * R))
        cx = Brep.from_cylinder(Cylinder(0.7 * R, 4 * R, frame=Frame.worldYZ()))
        cy = Brep.from_cylinder(Cylinder(0.7 * R, 4 * R, frame=Frame.worldZX()))
        cz = Brep.from_cylinder(Cylinder(0.7 * R, 4 * R, frame=Frame.worldXY()))

        result = box - cx - cy - cz

        return result.native_brep
# ---------- end brep_from_booleans ----------
py3 = Python3Script()  # -> out, capped, brep
# ---------- py3: Python ----------
import Rhino.Geometry as rg

# Reproduce the polygon points directly
points = [
    rg.Point3d(0.000, -0.050, 0.000),
    rg.Point3d(10.050, -0.050, 0.000),
    rg.Point3d(10.050, 10.050, 0.000),
    rg.Point3d(-0.050, 10.050, 0.000),
    rg.Point3d(-0.050, 5.000, 0.000),
    rg.Point3d(0.050, 5.000, 0.000),
    rg.Point3d(0.050, 9.950, 0.000),
    rg.Point3d(9.950, 9.950, 0.000),
    rg.Point3d(9.950, 0.050, 0.000),
    rg.Point3d(0.000, 0.050, 0.000),
]

# Close the polyline (required for extrusion to cap correctly)
points.append(points[0])

polyline = rg.Polyline(points)
curve = polyline.ToNurbsCurve()

extrusion = rg.Surface.CreateExtrusion(curve, rg.Vector3d(0, 0, 5))
brep = extrusion.ToBrep()
capped = brep.CapPlanarHoles(1e-6)
print(capped)
# Expose for GH preview
a = capped  # or: a = brep to compare uncapped
# ---------- end py3 ----------
brep_exchange = Brep_exchange()  # -> geometry
# ---------- brep_exchange: Python ----------
# venv: compas_brep_occ
import Grasshopper
import tempfile, os
from compas.geometry import Box, Cylinder, Frame
from compas.scene import Scene
from compas_brep import Brep

class Script_Instance(Grasshopper.Kernel.GH_ScriptInstance):
    def RunScript(self):

        R = 1.4
        box = Brep.from_box(Box(2 * R))
        cx = Brep.from_cylinder(Cylinder(0.7 * R, 4 * R, frame=Frame.worldYZ()))
        cy = Brep.from_cylinder(Cylinder(0.7 * R, 4 * R, frame=Frame.worldZX()))
        cz = Brep.from_cylinder(Cylinder(0.7 * R, 4 * R, frame=Frame.worldXY()))

        result = box - cx - cy - cz

        tmp = tempfile.gettempdir()
        step_path = os.path.join(tmp, "brep_exchange.step")
        brep.to_step(step_path)
        brep = Brep.from_step(step_path)

        return brep.native_brep
# ---------- end brep_exchange ----------
brep_serialisation = Brep_serialisation()  # -> geometry
# ---------- brep_serialisation: Python ----------
# venv: compas_brep_occ
import Grasshopper

class Script_Instance(Grasshopper.Kernel.GH_ScriptInstance):
    def RunScript(self):
        import compas
        from compas.geometry import Box, Cylinder, Frame
        from compas.scene import Scene
        from compas_brep import Brep

        R = 1.4
        box = Brep.from_box(Box(2 * R))
        cylx = Brep.from_cylinder(Cylinder(radius=0.7 * R, height=3 * R, frame=Frame.worldYZ()))
        cyly = Brep.from_cylinder(Cylinder(radius=0.7 * R, height=3 * R, frame=Frame.worldZX()))
        cylz = Brep.from_cylinder(Cylinder(radius=0.7 * R, height=3 * R, frame=Frame.worldXY()))
        brep = box - cylx - cyly - cylz

        brep = compas.json_loads(compas.json_dumps(brep))

        scene = Scene()
        scene.add(brep.to_viewmesh())
        return scene.draw()
# ---------- end brep_serialisation ----------
geo = Geometry(py3.capped)
geo_2 = Geometry(py3.brep)
geo_3 = Geometry(brep_from_extrusion2.r_extrusion)
py3_2 = Python3Script(y=Slider(6, range=0..10))  # -> out, a; inputs y: Int32
# ---------- py3_2: Python ----------
from compas_rhino.conversions import point_to_rhino, mesh_to_rhino

a = [point_to_rhino(x[y]), mesh_to_rhino(x.to_mesh())]
# ---------- end py3_2 ----------
brep_explorer = Brep_explorer()  # -> geometry
# ---------- brep_explorer: Python ----------
# venv: compas_brep_occ
import Grasshopper

class Script_Instance(Grasshopper.Kernel.GH_ScriptInstance):
    def RunScript(self):
        from compas.colors import Color
        from compas.geometry import Box
        from compas.scene import Scene
        from compas_brep import Brep

        box = Brep.from_box(Box(1))
        vertex = box.vertices[0]
        neighbors = box.vertex_neighbors(vertex)
        edges = box.vertex_edges(vertex)
        faces = box.vertex_faces(vertex)

        scene = Scene()
        scene.add(vertex.point)
        for v in neighbors:
            scene.add(v.point)
        for e in edges:
            scene.add(e.to_line())
        for f in faces:
            face_brep = Brep.from_brepfaces([f])
            scene.add(face_brep.to_viewmesh())
        scene.add(box.to_viewmesh())
        return scene.draw()
# ---------- end brep_explorer ----------
brep_intersections = Brep_intersections()  # -> geometry
# ---------- brep_intersections: Python ----------
# venv: compas_brep_occ
import Grasshopper

class Script_Instance(Grasshopper.Kernel.GH_ScriptInstance):
    def RunScript(self):
        from compas.geometry import Point, Sphere, NurbsCurve as CGNurbsCurve
        from compas.scene import Scene
        from compas_brep import Brep, NurbsSurface
        from compas_brep import NurbsCurve as BrepNC

        points = [
            [Point(0, 0, 0), Point(1, 0, 0), Point(2, 0, 0), Point(3, 0, 0)],
            [Point(0, 1, 0), Point(1, 1, 2), Point(2, 1, 2), Point(3, 1, 0)],
            [Point(0, 2, 0), Point(1, 2, 2), Point(2, 2, 2), Point(3, 2, 0)],
            [Point(0, 3, 0), Point(1, 3, 0), Point(2, 3, 0), Point(3, 3, 0)],
        ]
        surface = Brep.from_surface(NurbsSurface.from_points(points=points))
        sphere = Brep.from_sphere(Sphere(radius=1))
        x = Brep.from_boolean_intersection(surface, sphere)

        def brep_nc_to_cg(nc):
            return CGNurbsCurve.from_parameters(
                points=nc.points, weights=nc.weights,
                knots=nc.knots, multiplicities=nc.mults,
                degree=nc.degree, is_periodic=nc.is_periodic,
            )

        scene = Scene()
        scene.add(surface.to_viewmesh())
        scene.add(sphere.to_viewmesh())
        for edge in x.edges:
            c = edge.curve
            if isinstance(c, BrepNC):
                scene.add(brep_nc_to_cg(c))
            else:
                scene.add(c)
        return scene.draw()
# ---------- end brep_intersections ----------
brep_overlap = Brep_overlap()  # -> geometry
# ---------- brep_overlap: Python ----------
# venv: compas_brep_occ
import Grasshopper

class Script_Instance(Grasshopper.Kernel.GH_ScriptInstance):
    def RunScript(self):
        from compas.geometry import Box, Frame, Point, Vector
        from compas.scene import Scene
        from compas_brep import Brep

        A = Brep.from_box(Box(1))
        B = Brep.from_box(Box(1, frame=Frame(Point(0.5, 0.3, 0.25), Vector(1, 0, 0), Vector(0, 1, 0))))
        overlap = A.overlap(B)

        scene = Scene()
        scene.add(A.to_viewmesh())
        scene.add(B.to_viewmesh())
        scene.add(overlap.to_viewmesh())
        return scene.draw()
# ---------- end brep_overlap ----------
brep_slice = Brep_slice()  # -> geometry
# ---------- brep_slice: Python ----------
# venv: compas_brep_occ
import Grasshopper

class Script_Instance(Grasshopper.Kernel.GH_ScriptInstance):
    def RunScript(self):
        from math import radians
        from compas.geometry import Box, Plane, Polyline, Rotation
        from compas.scene import Scene
        from compas_brep import Brep

        box = Brep.from_box(Box(1))
        plane = Plane.worldXY()
        R = Rotation.from_axis_and_angle([0, 1, 0], radians(30))
        plane.transform(R)
        # slice returns a list of Polylines (cross-section contours)
        contours = box.slice(plane)

        scene = Scene()
        scene.add(box.to_viewmesh())
        for contour in contours:
            scene.add(contour)
        return scene.draw()
# ---------- end brep_slice ----------
brep_split = Brep_split()  # -> geometry
# ---------- brep_split: Python ----------
# venv: compas_brep_occ
import Grasshopper

class Script_Instance(Grasshopper.Kernel.GH_ScriptInstance):
    def RunScript(self):
        from math import radians
        from compas.geometry import Box, Plane, Rotation, is_point_infrontof_plane
        from compas.scene import Scene
        from compas_brep import Brep

        box = Brep.from_box(Box(1))
        R = Rotation.from_axis_and_angle([0, 1, 0], radians(30))
        plane = Plane.worldXY()
        plane.transform(R)
        splitter = Brep.from_plane(plane, domain_u=(-2, 2), domain_v=(-2, 2))
        result = box.split(splitter)

        scene = Scene()
        scene.add(splitter.to_viewmesh())
        for brep in result:
            scene.add(brep.to_viewmesh())
        return scene.draw()
# ---------- end brep_split ----------
brep_trim = Brep_trim()  # -> geometry
# ---------- brep_trim: Python ----------
# venv: compas_brep_occ
import Grasshopper

class Script_Instance(Grasshopper.Kernel.GH_ScriptInstance):
    def RunScript(self):
        from math import radians
        from compas.geometry import Box, Plane, Rotation
        from compas.scene import Scene
        from compas_brep import Brep

        box = Brep.from_box(Box(1))
        R = Rotation.from_axis_and_angle([0, 1, 0], radians(30))
        plane = Plane.worldXY()
        plane.transform(R)
        trimmed = box.trimmed(plane)

        scene = Scene()
        scene.add(plane)
        scene.add(trimmed.to_viewmesh())
        scene.add(box.to_viewmesh())
        return scene.draw()
# ---------- end brep_trim ----------
brep_with_hole = Brep_with_hole()  # -> geometry
# ---------- brep_with_hole: Python ----------
# venv: compas_brep_occ
import Grasshopper

class Script_Instance(Grasshopper.Kernel.GH_ScriptInstance):
    def RunScript(self):
        from compas.geometry import Cylinder, Frame, Point, Vector
        from compas.scene import Scene
        from compas_brep import Brep, NurbsSurface

        points = [
            [Point(0, 0, 0), Point(1, 0, 0), Point(2, 0, 0), Point(3, 0, 0)],
            [Point(0, 1, 0), Point(1, 1, 2), Point(2, 1, 2), Point(3, 1, 0)],
            [Point(0, 2, 0), Point(1, 2, 2), Point(2, 2, 2), Point(3, 2, 0)],
            [Point(0, 3, 0), Point(1, 3, 0), Point(2, 3, 0), Point(3, 3, 0)],
        ]
        surface_brep = Brep.from_surface(NurbsSurface.from_points(points=points))
        hole = Brep.from_cylinder(
            Cylinder(0.5, 4.0, frame=Frame(Point(1.5, 1.5, -1), Vector(0, 0, 1), Vector(1, 0, 0)))
        )
        brep = Brep.from_boolean_difference(surface_brep, hole)

        scene = Scene()
        scene.add(brep.to_viewmesh())
        return scene.draw()
# ---------- end brep_with_hole ----------
brep_with_holes = Brep_with_holes()  # -> geometry
# ---------- brep_with_holes: Python ----------
# venv: compas_brep_occ
import Grasshopper

class Script_Instance(Grasshopper.Kernel.GH_ScriptInstance):
    def RunScript(self):
        from compas.geometry import Box, Cylinder, Frame, Point, Polygon, Vector
        from compas.scene import Scene
        from compas_brep import Brep

        # Create a flat slab (thin box) as the "planar face" — Rhino boolean
        # difference requires closed solids, so an open plane cannot be used.
        polygon = Polygon([[-5, -5, 0], [5, -5, 0], [5, 5, 0], [-5, 5, 0]])
        face = Brep.from_extrusion(polygon, Vector(0, 0, 0.1))

        # Cylinders tall enough to punch all the way through the slab
        c1 = Brep.from_cylinder(Cylinder(1.0, 1.0, frame=Frame(Point(2, 2, 0), Vector(0, 0, 1), Vector(1, 0, 0))))
        c2 = Brep.from_cylinder(Cylinder(2.0, 1.0, frame=Frame(Point(-2, -2, 0), Vector(0, 0, 1), Vector(1, 0, 0))))
        c3 = Brep.from_cylinder(Cylinder(0.5, 1.0, frame=Frame(Point(2, -2, 0), Vector(0, 0, 1), Vector(1, 0, 0))))
        brep = face - c1 - c2 - c3

        scene = Scene()
        scene.add(brep.to_viewmesh())
        return scene.draw()
# ---------- end brep_with_holes ----------
brep_with_holes2 = Brep_with_holes2()  # -> geometry
# ---------- brep_with_holes2: Python ----------
# venv: compas_brep_occ
import Grasshopper

class Script_Instance(Grasshopper.Kernel.GH_ScriptInstance):
    def RunScript(self):
        from compas.geometry import Cylinder, Frame, Point, Polygon, Vector
        from compas.scene import Scene
        from compas_brep import Brep

        # Thin pentagonal extrusion as "face" — Rhino boolean difference
        # requires closed solids, so an open polygon face cannot be used.
        polygon = Polygon.from_sides_and_radius_xy(5, 10.0)
        face = Brep.from_extrusion(polygon, Vector(0, 0, 0.1))

        c1 = Brep.from_cylinder(Cylinder(1.0, 1.0, frame=Frame(Point(2, 2, 0), Vector(0, 0, 1), Vector(1, 0, 0))))
        c2 = Brep.from_cylinder(Cylinder(2.0, 1.0, frame=Frame(Point(-2, -2, 0), Vector(0, 0, 1), Vector(1, 0, 0))))
        c3 = Brep.from_cylinder(Cylinder(0.5, 1.0, frame=Frame(Point(2, -2, 0), Vector(0, 0, 1), Vector(1, 0, 0))))
        brep = face - c1 - c2 - c3

        scene = Scene()
        scene.add(brep.to_viewmesh())
        return scene.draw()
# ---------- end brep_with_holes2 ----------
brep_fillet = Brep_fillet()  # -> geometry
# ---------- brep_fillet: Python ----------
# venv: compas_brep_occ
import Grasshopper

class Script_Instance(Grasshopper.Kernel.GH_ScriptInstance):
    def RunScript(self):
        from pathlib import Path
        from compas.scene import Scene
        from compas_brep import Brep

        filepath = Path(__file__).parent / "FCA.stp" if hasattr(__file__, '__file__') else None
        # Try common locations for the FCA.stp file
        import os
        candidate = os.path.join(os.path.expanduser("~"), "repos", "GKR", "compas_brep", "examples", "breps", "FCA.stp")
        if os.path.exists(candidate):
            filepath = candidate
        else:
            raise FileNotFoundError(
                "FCA.stp not found. Place FCA.stp in examples/breps/ to run this example."
            )

        brep = Brep.from_step(filepath)
        letters = list(brep.solids)
        for letter in letters:
            letter.heal()
            letter.make_solid()

        for letter in letters:
            exclude = []
            for loop in letter.loops:
                do_fillet = True
                for edge in loop.edges:
                    for vertex in edge.vertices:
                        if any(e.length < 0.01 for e in letter.vertex_edges(vertex)):
                            do_fillet = False
                            break
                    if not do_fillet:
                        break
                if not do_fillet:
                    for vertex in loop.vertices:
                        for edge in letter.vertex_edges(vertex):
                            exclude.append(edge)
            letter.fillet(0.1, exclude=exclude)

        scene = Scene()
        for letter in letters:
            scene.add(letter.to_viewmesh())
        return scene.draw()
# ---------- end brep_fillet ----------
